# Grasshopper definition ico sobre ico convergete orden 3 normalizado.gh (Grasshopper 0.9.76)

number_slider = Slider(1, range=0..1)
number_slider_2 = Slider(2, range=0..50)
knob = ControlKnob(Decimals=2, Limit=True, Maximum=10, Minimum=0, Range=1, Value=3.02)
geo = Geometry([<curve referenced from the Rhino model> x32])
line = Line(Line((0, 0, 2), (0, 0, 0)))
divide = DivideCurve(Curve=line, Count=number_slider, Kinks=False)  # -> Points, Tangents, Parameters
sph = Sphere(Base=PlaneXY(0, 0, 0), Radius=knob)
item = ListItem(List=divide.Points, Index=number_slider, Wrap=True)
knob_2 = ControlKnob(Decimals=4, Limit=True, Maximum=10, Minimum=0, Range=1, Value=0)
pln = Plane(PlaneYZ(0, 0, 0))
rotate = Rotate(Geometry=geo, Angle=knob_2, Plane=pln)  # -> Geometry, Transform
line_2 = Line(rotate.Geometry)
panel = Panel(line_2)
knob_3 = ControlKnob(Decimals=2, Limit=True, Maximum=10, Minimum=0, Range=1, Value=3.7)
knob_4 = ControlKnob(Decimals=4, Limit=True, Maximum=20.1, Minimum=-20, Range=1, Value=1.0779)
a = Number(knob_3)
dom = ConstructDomain(DomainStart=Slider(1e-06, range=0..1e-06), DomainEnd=a)
panel_2 = Panel(dom)
range = Range(Domain=panel_2, Steps=Slider(62, range=0..100))
x = Number(range)
knob_5 = ControlKnob(Decimals=2, Limit=True, Maximum=10, Minimum=0, Range=1, Value=0.08)
knob_6 = ControlKnob(Decimals=2, Limit=True, Maximum=10, Minimum=0, Range=1, Value=0.87)
sqr = Square(Value=x)
knob_7 = ControlKnob(Decimals=2, Limit=True, Maximum=10, Minimum=0, Range=1, Value=2.39)
sqr_2 = Square(Value=a)
subtraction = Subtraction(A=sqr_2, B=sqr)
sqrt = SquareRoot(Value=subtraction)
addition = Addition(A=a, B=sqrt)
division = Division(A=addition, B=x)
ln = NaturalLogarithm(Value=division)
multiplication = Multiplication(A=ln, B=a)
subtraction_2 = Subtraction(A=multiplication, B=sqrt)
line_3 = Line(Line((0, 0, 0), (0, 0, 3)))
pt = ConstructPoint(XCoordinate=x, YCoordinate=0, ZCoordinate=subtraction_2)
intcrv = Interpolate(Vertices=pt, Degree=3, Periodic=False, KnotStyle=1)  # -> Curve, Length, Domain
revsrf = Revolution(Curve=intcrv.Curve, Axis=line_3, Domain=Domain(0, 6.283185307))
number_slider_3 = Slider(1, range=0..1)
number_slider_4 = Slider(20, range=0..100)
number_slider_5 = Slider(2, range=0..50)
line_4 = Line(Line((0, 0, 2), (0, 0, 0)))
divide_2 = DivideCurve(Curve=line_4, Count=number_slider_3, Kinks=False)  # -> Points, Tangents, Parameters
item_2 = ListItem(List=divide_2.Points, Index=number_slider_3, Wrap=True)
knob_8 = ControlKnob(Decimals=4, Limit=True, Maximum=10, Minimum=0, Range=1, Value=0)
pln_2 = Plane(Plane(origin=(0, 0, 0), x=(0, 0, 1), y=(1, 0, 0)))
knob_9 = ControlKnob(Decimals=2, Limit=True, Maximum=10, Minimum=0, Range=1, Value=6.15)
sph_2 = Sphere(Base=PlaneXY(0, 0, 0), Radius=knob_9)
knob_10 = ControlKnob(Decimals=4, Limit=True, Maximum=20.1, Minimum=-20, Range=1, Value=1.0779)
a_2 = Number(knob_9)
dom_2 = ConstructDomain(DomainStart=Slider(1e-06, range=0..1e-06), DomainEnd=a_2)
panel_3 = Panel(dom_2)
range_2 = Range(Domain=panel_3, Steps=Slider(62, range=0..100))
x_2 = Number(range_2)
knob_11 = ControlKnob(Decimals=2, Limit=True, Maximum=10, Minimum=0, Range=1, Value=0.33)
knob_12 = ControlKnob(Decimals=2, Limit=True, Maximum=10, Minimum=0, Range=1, Value=1.65)
sqr_3 = Square(Value=x_2)
knob_13 = ControlKnob(Decimals=2, Limit=True, Maximum=10, Minimum=0, Range=1, Value=2.2)
sqr_4 = Square(Value=a_2)
subtraction_3 = Subtraction(A=sqr_4, B=sqr_3)
sqrt_2 = SquareRoot(Value=subtraction_3)
addition_2 = Addition(A=a_2, B=sqrt_2)
division_2 = Division(A=addition_2, B=x_2)
ln_2 = NaturalLogarithm(Value=division_2)
multiplication_2 = Multiplication(A=ln_2, B=a_2)
subtraction_4 = Subtraction(A=multiplication_2, B=sqrt_2)
line_5 = Line(Line((0, 0, 0), (0, 0, 3)))
pt_2 = ConstructPoint(XCoordinate=x_2, YCoordinate=0, ZCoordinate=subtraction_4)
intcrv_2 = Interpolate(Vertices=pt_2, Degree=3, Periodic=False, KnotStyle=1)  # -> Curve, Length, Domain
revsrf_2 = Revolution(Curve=intcrv_2.Curve, Axis=line_5, Domain=Domain(0, 6.283185307))
number_slider_6 = Slider(1, range=0..1)
number_slider_7 = Slider(2, range=0..50)
line_6 = Line(Line((0, 0, 2), (0, 0, 0)))
divide_3 = DivideCurve(Curve=line_6, Count=number_slider_6, Kinks=False)  # -> Points, Tangents, Parameters
item_3 = ListItem(List=divide_3.Points, Index=number_slider_6, Wrap=True)
knob_14 = ControlKnob(Decimals=4, Limit=True, Maximum=10, Minimum=0, Range=1, Value=0)
knob_15 = ControlKnob(Decimals=2, Limit=True, Maximum=20, Minimum=0, Range=1, Value=8.25)
pln_3 = Plane(Plane(origin=(0, 0, 0), x=(0, 0, 1), y=(1, 0, 0)))
sph_3 = Sphere(Base=PlaneXY(0, 0, 0), Radius=knob_15)
knob_16 = ControlKnob(Decimals=4, Limit=True, Maximum=20.1, Minimum=-20, Range=1, Value=1.0779)
a_3 = Number(knob_15)
dom_3 = ConstructDomain(DomainStart=Slider(1e-06, range=0..1e-06), DomainEnd=a_3)
panel_4 = Panel(dom_3)
range_3 = Range(Domain=panel_4, Steps=Slider(62, range=0..100))
x_3 = Number(range_3)
knob_17 = ControlKnob(Decimals=2, Limit=True, Maximum=10, Minimum=0, Range=1, Value=0.23)
knob_18 = ControlKnob(Decimals=2, Limit=True, Maximum=10, Minimum=0, Range=1, Value=0.65)
sqr_5 = Square(Value=x_3)
knob_19 = ControlKnob(Decimals=2, Limit=True, Maximum=10, Minimum=0, Range=1, Value=1.4)
sqr_6 = Square(Value=a_3)
subtraction_5 = Subtraction(A=sqr_6, B=sqr_5)
sqrt_3 = SquareRoot(Value=subtraction_5)
addition_3 = Addition(A=a_3, B=sqrt_3)
division_3 = Division(A=addition_3, B=x_3)
ln_3 = NaturalLogarithm(Value=division_3)
multiplication_3 = Multiplication(A=ln_3, B=a_3)
subtraction_6 = Subtraction(A=multiplication_3, B=sqrt_3)
line_7 = Line(Line((0, 0, 0), (0, 0, 3)))
pt_3 = ConstructPoint(XCoordinate=x_3, YCoordinate=0, ZCoordinate=subtraction_6)
intcrv_3 = Interpolate(Vertices=pt_3, Degree=3, Periodic=False, KnotStyle=1)  # -> Curve, Length, Domain
revsrf_3 = Revolution(Curve=intcrv_3.Curve, Axis=line_7, Domain=Domain(0, 6.283185307))
number_slider_8 = Slider(1, range=0..1)
number_slider_9 = Slider(13, range=0..50)
line_8 = Line(Line((0, 0, 2), (0, 0, 0)))
divide_4 = DivideCurve(Curve=line_8, Count=number_slider_8, Kinks=False)  # -> Points, Tangents, Parameters
item_4 = ListItem(List=divide_4.Points, Index=number_slider_8, Wrap=True)
knob_20 = ControlKnob(Decimals=4, Limit=True, Maximum=10, Minimum=0, Range=1, Value=0)
pln_4 = Plane(Plane(origin=(0, 0, 0), x=(0, 0, 1), y=(1, 0, 0)))
knob_21 = ControlKnob(Decimals=2, Limit=True, Maximum=20, Minimum=0, Range=1, Value=15)
sph_4 = Sphere(Base=PlaneXY(0, 0, 0), Radius=knob_21)
knob_22 = ControlKnob(Decimals=4, Limit=True, Maximum=20.1, Minimum=-20, Range=1, Value=1.0779)
a_4 = Number(knob_21)
dom_4 = ConstructDomain(DomainStart=Slider(1e-06, range=0..1e-06), DomainEnd=a_4)
panel_5 = Panel(dom_4)
range_4 = Range(Domain=panel_5, Steps=Slider(62, range=0..100))
x_4 = Number(range_4)
knob_23 = ControlKnob(Decimals=2, Limit=True, Maximum=10, Minimum=0, Range=1, Value=0.23)
knob_24 = ControlKnob(Decimals=2, Limit=True, Maximum=10, Minimum=0, Range=1, Value=0.65)
sqr_7 = Square(Value=x_4)
knob_25 = ControlKnob(Decimals=2, Limit=True, Maximum=10, Minimum=0, Range=1, Value=2.46)
sqr_8 = Square(Value=a_4)
subtraction_7 = Subtraction(A=sqr_8, B=sqr_7)
sqrt_4 = SquareRoot(Value=subtraction_7)
addition_4 = Addition(A=a_4, B=sqrt_4)
division_4 = Division(A=addition_4, B=x_4)
ln_4 = NaturalLogarithm(Value=division_4)
multiplication_4 = Multiplication(A=ln_4, B=a_4)
subtraction_8 = Subtraction(A=multiplication_4, B=sqrt_4)
line_9 = Line(Line((0, 0, 0), (0, 0, 3)))
pt_4 = ConstructPoint(XCoordinate=x_4, YCoordinate=0, ZCoordinate=subtraction_8)
intcrv_4 = Interpolate(Vertices=pt_4, Degree=3, Periodic=False, KnotStyle=1)  # -> Curve, Length, Domain
revsrf_4 = Revolution(Curve=intcrv_4.Curve, Axis=line_9, Domain=Domain(0, 6.283185307))
number_slider_10 = Slider(3, range=0..100)
divide_5 = DivideCurve(Curve=line_2, Count=number_slider_10, Kinks=False)  # -> flatten(Points), Tangents, reverse(Parameters)
panel_6 = Panel(divide_5.Points)
cullpt = CullDuplicates(Points=divide_5.Points, Tolerance=0.1, CullMode=3)  # -> Points, Indices, Valence
panel_7 = Panel(cullpt.Points)
ln_5 = Line(StartPoint=item, EndPoint=cullpt.Points)
vec = Vector(flatten(ln_5))
panel_8 = Panel(vec)
item_5 = ListItem(List=cullpt.Points, Index=Slider(68, range=0..100), Wrap=True)
dist = Distance(PointA=item, PointB=item_5)
panel_9 = Panel(dist)
addition_5 = Addition(A=dist, B=knob_4)
sph_5 = Sphere(Base=item, Radius=addition_5)
project = ProjectPoint(Point=cullpt.Points, Direction=ln_5, Geometry=sph)  # -> Point, Index
pt_5 = Point(flatten(project.Point))
cullpt_2 = CullDuplicates(Points=pt_5, Tolerance=knob_5, CullMode=3)  # -> flatten(Points), Indices, Valence
pt_6 = Point(cullpt.Points)
panel_10 = Panel(cullpt_2.Points)
prox = Proximity3D(Points=cullpt_2.Points, Group=Slider(9, range=0..10), MinRadius=knob_6, MaxRadius=knob_7)  # -> flatten(Links), Topology
line_10 = Line(flatten(prox.Links))
panel_11 = Panel(pt_5)
panel_12 = Panel(line_10)
geo_2 = Geometry(line_10)
rotate_2 = Rotate(Geometry=geo_2, Angle=knob_8, Plane=pln_2)  # -> Geometry, Transform
line_11 = Line(rotate_2.Geometry)
divide_6 = DivideCurve(Curve=line_11, Count=number_slider_10, Kinks=False)  # -> flatten(Points), Tangents, reverse(Parameters)
panel_13 = Panel(line_11)
panel_14 = Panel(divide_6.Points)
cullpt_3 = CullDuplicates(Points=divide_6.Points, Tolerance=0.1, CullMode=3)  # -> Points, Indices, Valence
panel_15 = Panel(cullpt_3.Points)
ln_6 = Line(StartPoint=item_2, EndPoint=cullpt_3.Points)
vec_2 = Vector(flatten(ln_6))
panel_16 = Panel(vec_2)
item_6 = ListItem(List=cullpt_3.Points, Index=Slider(68, range=0..100), Wrap=True)
dist_2 = Distance(PointA=item_2, PointB=item_6)
panel_17 = Panel(dist_2)
addition_6 = Addition(A=dist_2, B=knob_10)
sph_6 = Sphere(Base=item_2, Radius=addition_6)
project_2 = ProjectPoint(Point=cullpt_3.Points, Direction=ln_6, Geometry=sph_2)  # -> Point, Index
pt_7 = Point(flatten(project_2.Point))
cullpt_4 = CullDuplicates(Points=pt_7, Tolerance=knob_11, CullMode=3)  # -> flatten(Points), Indices, Valence
pt_8 = Point(cullpt_3.Points)
panel_18 = Panel(cullpt_4.Points)
prox_2 = Proximity3D(Points=cullpt_4.Points, Group=Slider(7, range=0..10), MinRadius=knob_12, MaxRadius=knob_13)  # -> flatten(Links), Topology
line_12 = Line(flatten(prox_2.Links))
panel_19 = Panel(pt_7)
panel_20 = Panel(line_12)
geo_3 = Geometry(line_12)
rotate_3 = Rotate(Geometry=geo_3, Angle=knob_14, Plane=pln_3)  # -> Geometry, Transform
line_13 = Line(rotate_3.Geometry)
divide_7 = DivideCurve(Curve=line_13, Count=number_slider_10, Kinks=False)  # -> flatten(Points), Tangents, reverse(Parameters)
panel_21 = Panel(line_13)
panel_22 = Panel(divide_7.Points)
cullpt_5 = CullDuplicates(Points=divide_7.Points, Tolerance=0.1, CullMode=3)  # -> Points, Indices, Valence
panel_23 = Panel(cullpt_5.Points)
ln_7 = Line(StartPoint=item_3, EndPoint=cullpt_5.Points)
vec_3 = Vector(flatten(ln_7))
panel_24 = Panel(vec_3)
item_7 = ListItem(List=cullpt_5.Points, Index=Slider(68, range=0..100), Wrap=True)
dist_3 = Distance(PointA=item_3, PointB=item_7)
panel_25 = Panel(dist_3)
addition_7 = Addition(A=dist_3, B=knob_16)
sph_7 = Sphere(Base=item_3, Radius=addition_7)
project_3 = ProjectPoint(Point=cullpt_5.Points, Direction=ln_7, Geometry=sph_3)  # -> Point, Index
pt_9 = Point(flatten(project_3.Point))
cullpt_6 = CullDuplicates(Points=pt_9, Tolerance=knob_17, CullMode=3)  # -> flatten(Points), Indices, Valence
pt_10 = Point(cullpt_5.Points)
panel_26 = Panel(cullpt_6.Points)
prox_3 = Proximity3D(Points=cullpt_6.Points, Group=Slider(8, range=0..10), MinRadius=knob_18, MaxRadius=knob_19)  # -> flatten(Links), Topology
line_14 = Line(flatten(prox_3.Links))
panel_27 = Panel(pt_9)
panel_28 = Panel(line_14)
geo_4 = Geometry(line_14)
rotate_4 = Rotate(Geometry=geo_4, Angle=knob_20, Plane=pln_4)  # -> Geometry, Transform
line_15 = Line(rotate_4.Geometry)
divide_8 = DivideCurve(Curve=line_15, Count=number_slider_10, Kinks=False)  # -> flatten(Points), Tangents, reverse(Parameters)
panel_29 = Panel(line_15)
panel_30 = Panel(divide_8.Points)
cullpt_7 = CullDuplicates(Points=divide_8.Points, Tolerance=0.1, CullMode=3)  # -> Points, Indices, Valence
panel_31 = Panel(cullpt_7.Points)
ln_8 = Line(StartPoint=item_4, EndPoint=cullpt_7.Points)
vec_4 = Vector(flatten(ln_8))
panel_32 = Panel(vec_4)
item_8 = ListItem(List=cullpt_7.Points, Index=Slider(68, range=0..100), Wrap=True)
dist_4 = Distance(PointA=item_4, PointB=item_8)
panel_33 = Panel(dist_4)
addition_8 = Addition(A=dist_4, B=knob_22)
sph_8 = Sphere(Base=item_4, Radius=addition_8)
project_4 = ProjectPoint(Point=cullpt_7.Points, Direction=ln_8, Geometry=sph_4)  # -> Point, Index
pt_11 = Point(flatten(project_4.Point))
cullpt_8 = CullDuplicates(Points=pt_11, Tolerance=knob_23, CullMode=3)  # -> flatten(Points), Indices, Valence
pt_12 = Point(cullpt_7.Points)
panel_34 = Panel(cullpt_8.Points)
prox_4 = Proximity3D(Points=cullpt_8.Points, Group=Slider(6, range=0..10), MinRadius=knob_24, MaxRadius=knob_25)  # -> flatten(Links), Topology
line_16 = Line(flatten(prox_4.Links))
panel_35 = Panel(pt_11)
panel_36 = Panel(line_16)
number_slider_11 = Slider(1, range=0..1)
number_slider_12 = Slider(2, range=0..50)
line_17 = Line(Line((0, 0, 2), (0, 0, 0)))
divide_9 = DivideCurve(Curve=line_17, Count=number_slider_11, Kinks=False)  # -> Points, Tangents, Parameters
item_9 = ListItem(List=divide_9.Points, Index=number_slider_11, Wrap=True)
knob_26 = ControlKnob(Decimals=4, Limit=True, Maximum=10, Minimum=0, Range=1, Value=0)
pln_5 = Plane(Plane(origin=(0, 0, 0), x=(0, 0, 1), y=(1, 0, 0)))
rotate_5 = Rotate(Geometry=line_16, Angle=knob_26, Plane=pln_5)  # -> Geometry, Transform
line_18 = Line(rotate_5.Geometry)
divide_10 = DivideCurve(Curve=line_18, Count=number_slider_10, Kinks=False)  # -> flatten(Points), Tangents, reverse(Parameters)
panel_37 = Panel(line_18)
panel_38 = Panel(divide_10.Points)
cullpt_9 = CullDuplicates(Points=divide_10.Points, Tolerance=0.1, CullMode=3)  # -> Points, Indices, Valence
panel_39 = Panel(cullpt_9.Points)
ln_9 = Line(StartPoint=item_9, EndPoint=cullpt_9.Points)
vec_5 = Vector(flatten(ln_9))
panel_40 = Panel(vec_5)
item_10 = ListItem(List=cullpt_9.Points, Index=Slider(68, range=0..100), Wrap=True)
knob_27 = ControlKnob(Decimals=2, Limit=True, Maximum=20, Minimum=0, Range=1, Value=17)
sph_9 = Sphere(Base=PlaneXY(0, 0, 0), Radius=knob_27)
dist_5 = Distance(PointA=item_9, PointB=item_10)
panel_41 = Panel(dist_5)
project_5 = ProjectPoint(Point=cullpt_9.Points, Direction=ln_9, Geometry=sph_9)  # -> Point, Index
knob_28 = ControlKnob(Decimals=4, Limit=True, Maximum=20.1, Minimum=-20, Range=1, Value=1.0779)
addition_9 = Addition(A=dist_5, B=knob_28)
sph_10 = Sphere(Base=item_9, Radius=addition_9)
a_5 = Number(knob_27)
dom_5 = ConstructDomain(DomainStart=Slider(1e-06, range=0..1e-06), DomainEnd=a_5)
panel_42 = Panel(dom_5)
range_5 = Range(Domain=panel_42, Steps=Slider(62, range=0..100))
x_5 = Number(range_5)
pt_13 = Point(flatten(project_5.Point))
knob_29 = ControlKnob(Decimals=2, Limit=True, Maximum=10, Minimum=0, Range=1, Value=0.23)
knob_30 = ControlKnob(Decimals=2, Limit=True, Maximum=10, Minimum=0, Range=1, Value=0.37)
cullpt_10 = CullDuplicates(Points=pt_13, Tolerance=knob_29, CullMode=3)  # -> flatten(Points), Indices, Valence
pt_14 = Point(cullpt_9.Points)
sqr_9 = Square(Value=x_5)
knob_31 = ControlKnob(Decimals=2, Limit=True, Maximum=10, Minimum=0, Range=1, Value=3.07)
sqr_10 = Square(Value=a_5)
panel_43 = Panel(cullpt_10.Points)
subtraction_9 = Subtraction(A=sqr_10, B=sqr_9)
prox_5 = Proximity3D(Points=cullpt_10.Points, Group=Slider(6, range=0..10), MinRadius=knob_30, MaxRadius=knob_31)  # -> flatten(Links), Topology
sqrt_5 = SquareRoot(Value=subtraction_9)
addition_10 = Addition(A=a_5, B=sqrt_5)
division_5 = Division(A=addition_10, B=x_5)
ln_10 = NaturalLogarithm(Value=division_5)
line_19 = Line(flatten(prox_5.Links))
panel_44 = Panel(pt_13)
multiplication_5 = Multiplication(A=ln_10, B=a_5)
subtraction_10 = Subtraction(A=multiplication_5, B=sqrt_5)
panel_45 = Panel(line_19)
line_20 = Line(Line((0, 0, 0), (0, 0, 3)))
pt_15 = ConstructPoint(XCoordinate=x_5, YCoordinate=0, ZCoordinate=subtraction_10)
intcrv_5 = Interpolate(Vertices=pt_15, Degree=3, Periodic=False, KnotStyle=1)  # -> Curve, Length, Domain
revsrf_5 = Revolution(Curve=intcrv_5.Curve, Axis=line_20, Domain=Domain(0, 6.283185307))
