# Grasshopper definition ico sobre pseudo marzo.gh (Grasshopper 0.9.76)

number_slider = Slider(1, range=0..1)
geo = Geometry([<curve referenced from the Rhino model> x32])
line = Line(Line((0, 0, 2), (0, 0, 0)))
divide = DivideCurve(Curve=line, Count=number_slider, Kinks=False)  # -> Points, Tangents, Parameters
item = ListItem(List=divide.Points, Index=number_slider, Wrap=True)
knob = ControlKnob(Decimals=4, Limit=True, Maximum=10, Minimum=0, Range=1, Value=1.0386)
pln = Plane(Plane(origin=(0, 0, 0), x=(0, 0, 1), y=(1, 0, 0)))
rotate = Rotate(Geometry=geo, Angle=knob, Plane=pln)  # -> Geometry, Transform
line_2 = Line(rotate.Geometry)
divide_2 = DivideCurve(Curve=line_2, Count=Slider(10, range=0..10), Kinks=False)  # -> flatten(Points), Tangents, Parameters
panel = Panel(line_2)
panel_2 = Panel(divide_2.Points)
cullpt = CullDuplicates(Points=divide_2.Points, Tolerance=0.1, CullMode=3)  # -> Points, Indices, Valence
panel_3 = Panel(cullpt.Points)
ln = Line(StartPoint=item, EndPoint=cullpt.Points)
vec = Vector(flatten(ln))
panel_4 = Panel(vec)
item_2 = ListItem(List=cullpt.Points, Index=Slider(68, range=0..100), Wrap=True)
dist = Distance(PointA=item, PointB=item_2)
panel_5 = Panel(dist)
knob_2 = ControlKnob(Decimals=2, Limit=True, Maximum=10, Minimum=0, Range=1, Value=3.7)
knob_3 = ControlKnob(Decimals=4, Limit=True, Maximum=20.1, Minimum=-20, Range=1, Value=1.0779)
addition = Addition(A=dist, B=knob_3)
sph = Sphere(Base=item, Radius=addition)
a = Number(knob_2)
dom = ConstructDomain(DomainStart=Slider(1e-06, range=0..1e-06), DomainEnd=a)
panel_6 = Panel(dom)
range = Range(Domain=panel_6, Steps=Slider(62, range=0..100))
x = Number(range)
knob_4 = ControlKnob(Decimals=2, Limit=True, Maximum=10, Minimum=0, Range=1, Value=0.08)
knob_5 = ControlKnob(Decimals=2, Limit=True, Maximum=10, Minimum=0, Range=1, Value=0.87)
pt = Point(cullpt.Points)
sqr = Square(Value=x)
sqr_2 = Square(Value=a)
knob_6 = ControlKnob(Decimals=2, Limit=True, Maximum=10, Minimum=0, Range=1, Value=2.13)
subtraction = Subtraction(A=sqr_2, B=sqr)
sqrt = SquareRoot(Value=subtraction)
addition_2 = Addition(A=a, B=sqrt)
division = Division(A=addition_2, B=x)
ln_2 = NaturalLogarithm(Value=division)
multiplication = Multiplication(A=ln_2, B=a)
subtraction_2 = Subtraction(A=multiplication, B=sqrt)
line_3 = Line(Line((0, 0, 0), (0, 0, 3)))
pt_2 = ConstructPoint(XCoordinate=x, YCoordinate=0, ZCoordinate=subtraction_2)
intcrv = Interpolate(Vertices=pt_2, Degree=3, Periodic=False, KnotStyle=1)  # -> Curve, Length, Domain
revsrf = Revolution(Curve=intcrv.Curve, Axis=line_3, Domain=Domain(0, 6.283185307))
project = ProjectPoint(Point=cullpt.Points, Direction=ln, Geometry=revsrf)  # -> Point, Index
pt_3 = Point(flatten(project.Point))
cullpt_2 = CullDuplicates(Points=pt_3, Tolerance=knob_4, CullMode=3)  # -> flatten(Points), Indices, Valence
panel_7 = Panel(cullpt_2.Points)
prox = Proximity3D(Points=cullpt_2.Points, Group=Slider(10, range=0..10), MinRadius=knob_5, MaxRadius=knob_6)  # -> flatten(Links), Topology
line_4 = Line(flatten(prox.Links))
panel_8 = Panel(pt_3)
panel_9 = Panel(line_4)
