# Grasshopper definition ico sobre pseudo marzo4.gh (Grasshopper 0.9.76)

number_slider = Slider(1, range=0..1)
geo = Geometry([<curve referenced from the Rhino model> x32])
line = Line(Line((0, 0, 2), (0, 0, 0)))
divide = DivideCurve(Curve=line, Count=number_slider, Kinks=False)  # -> Points, Tangents, Parameters
item = ListItem(List=divide.Points, Index=number_slider, Wrap=True)
knob = ControlKnob(Decimals=5, Limit=True, Maximum=10, Minimum=0, Range=1, Value=2.03448)
division = Division(A=knob, B=Slider(2, range=0..10))
pln = Plane(Plane(origin=(0, 0, 0), x=(0, 0, 1), y=(1, 0, 0)))
rotate = Rotate(Geometry=geo, Angle=division, Plane=pln)  # -> Geometry, Transform
line_2 = Line(rotate.Geometry)
divide_2 = DivideCurve(Curve=line_2, Count=Slider(2, range=0..50), Kinks=False)  # -> flatten(Points), Tangents, reverse(Parameters)
panel = Panel(line_2)
panel_2 = Panel(divide_2.Points)
cullpt = CullDuplicates(Points=divide_2.Points, Tolerance=0.1, CullMode=3)  # -> Points, Indices, Valence
panel_3 = Panel(cullpt.Points)
ln = Line(StartPoint=item, EndPoint=cullpt.Points)
vec = Vector(flatten(ln))
panel_4 = Panel(vec)
item_2 = ListItem(List=cullpt.Points, Index=Slider(68, range=0..100), Wrap=True)
dist = Distance(PointA=item, PointB=item_2)
panel_5 = Panel(dist)
knob_2 = ControlKnob(Decimals=2, Limit=True, Maximum=10, Minimum=0, Range=1, Value=3.7)
knob_3 = ControlKnob(Decimals=4, Limit=True, Maximum=20.1, Minimum=-20, Range=1, Value=1.0779)
addition = Addition(A=dist, B=knob_3)
sph = Sphere(Base=item, Radius=addition)
a = Number(knob_2)
dom = ConstructDomain(DomainStart=Slider(1e-06, range=0..1e-06), DomainEnd=a)
panel_6 = Panel(dom)
range = Range(Domain=panel_6, Steps=Slider(62, range=0..100))
x = Number(range)
knob_4 = ControlKnob(Decimals=2, Limit=True, Maximum=10, Minimum=0, Range=1, Value=0.08)
knob_5 = ControlKnob(Decimals=2, Limit=True, Maximum=10, Minimum=0, Range=1, Value=0.87)
pt = Point(cullpt.Points)
sqr = Square(Value=x)
knob_6 = ControlKnob(Decimals=2, Limit=True, Maximum=10, Minimum=0, Range=1, Value=2.3)
sqr_2 = Square(Value=a)
subtraction = Subtraction(A=sqr_2, B=sqr)
sqrt = SquareRoot(Value=subtraction)
addition_2 = Addition(A=a, B=sqrt)
division_2 = Division(A=addition_2, B=x)
ln_2 = NaturalLogarithm(Value=division_2)
multiplication = Multiplication(A=ln_2, B=a)
subtraction_2 = Subtraction(A=multiplication, B=sqrt)
line_3 = Line(Line((0, 0, 0), (0, 0, 3)))
pt_2 = ConstructPoint(XCoordinate=x, YCoordinate=0, ZCoordinate=subtraction_2)
intcrv = Interpolate(Vertices=pt_2, Degree=3, Periodic=False, KnotStyle=1)  # -> Curve, Length, Domain
revsrf = Revolution(Curve=intcrv.Curve, Axis=line_3, Domain=Domain(0, 6.283185307))
project = ProjectPoint(Point=cullpt.Points, Direction=ln, Geometry=revsrf)  # -> Point, Index
pt_3 = Point(flatten(project.Point))
cullpt_2 = CullDuplicates(Points=pt_3, Tolerance=knob_4, CullMode=3)  # -> flatten(Points), Indices, Valence
panel_7 = Panel(cullpt_2.Points)
prox = Proximity3D(Points=cullpt_2.Points, Group=Slider(9, range=0..10), MinRadius=knob_5, MaxRadius=knob_6)  # -> flatten(Links), Topology
line_4 = Line(flatten(prox.Links))
panel_8 = Panel(pt_3)
panel_9 = Panel(line_4)
number_slider_2 = Slider(1, range=0..1)
geo_2 = Geometry(line_4)
line_5 = Line(Line((0, 0, 2), (0, 0, 0)))
divide_3 = DivideCurve(Curve=line_5, Count=number_slider_2, Kinks=False)  # -> Points, Tangents, Parameters
item_3 = ListItem(List=divide_3.Points, Index=number_slider_2, Wrap=True)
knob_7 = ControlKnob(Decimals=4, Limit=True, Maximum=10, Minimum=0, Range=1, Value=0)
pln_2 = Plane(Plane(origin=(0, 0, 0), x=(0, 0, 1), y=(1, 0, 0)))
rotate_2 = Rotate(Geometry=geo_2, Angle=knob_7, Plane=pln_2)  # -> Geometry, Transform
line_6 = Line(rotate_2.Geometry)
divide_4 = DivideCurve(Curve=line_6, Count=Slider(31, range=0..50), Kinks=False)  # -> flatten(Points), Tangents, reverse(Parameters)
panel_10 = Panel(line_6)
panel_11 = Panel(divide_4.Points)
cullpt_3 = CullDuplicates(Points=divide_4.Points, Tolerance=0.1, CullMode=3)  # -> Points, Indices, Valence
panel_12 = Panel(cullpt_3.Points)
ln_3 = Line(StartPoint=item_3, EndPoint=cullpt_3.Points)
vec_2 = Vector(flatten(ln_3))
panel_13 = Panel(vec_2)
item_4 = ListItem(List=cullpt_3.Points, Index=Slider(68, range=0..100), Wrap=True)
dist_2 = Distance(PointA=item_3, PointB=item_4)
panel_14 = Panel(dist_2)
knob_8 = ControlKnob(Decimals=2, Limit=True, Maximum=10, Minimum=0, Range=1, Value=10)
knob_9 = ControlKnob(Decimals=4, Limit=True, Maximum=20.1, Minimum=-20, Range=1, Value=1.0779)
addition_3 = Addition(A=dist_2, B=knob_9)
sph_2 = Sphere(Base=item_3, Radius=addition_3)
a_2 = Number(knob_8)
dom_2 = ConstructDomain(DomainStart=Slider(1e-06, range=0..1e-06), DomainEnd=a_2)
panel_15 = Panel(dom_2)
range_2 = Range(Domain=panel_15, Steps=Slider(62, range=0..100))
x_2 = Number(range_2)
knob_10 = ControlKnob(Decimals=2, Limit=True, Maximum=10, Minimum=0, Range=1, Value=0.23)
knob_11 = ControlKnob(Decimals=2, Limit=True, Maximum=10, Minimum=0, Range=1, Value=0.86)
pt_4 = Point(cullpt_3.Points)
sqr_3 = Square(Value=x_2)
knob_12 = ControlKnob(Decimals=2, Limit=True, Maximum=10, Minimum=0, Range=1, Value=1.38)
sqr_4 = Square(Value=a_2)
subtraction_3 = Subtraction(A=sqr_4, B=sqr_3)
sqrt_2 = SquareRoot(Value=subtraction_3)
addition_4 = Addition(A=a_2, B=sqrt_2)
division_3 = Division(A=addition_4, B=x_2)
ln_4 = NaturalLogarithm(Value=division_3)
multiplication_2 = Multiplication(A=ln_4, B=a_2)
subtraction_4 = Subtraction(A=multiplication_2, B=sqrt_2)
line_7 = Line(Line((0, 0, 0), (0, 0, 3)))
pt_5 = ConstructPoint(XCoordinate=x_2, YCoordinate=0, ZCoordinate=subtraction_4)
intcrv_2 = Interpolate(Vertices=pt_5, Degree=3, Periodic=False, KnotStyle=1)  # -> Curve, Length, Domain
revsrf_2 = Revolution(Curve=intcrv_2.Curve, Axis=line_7, Domain=Domain(0, 6.283185307))
project_2 = ProjectPoint(Point=cullpt_3.Points, Direction=ln_3, Geometry=revsrf_2)  # -> Point, Index
pt_6 = Point(flatten(project_2.Point))
cullpt_4 = CullDuplicates(Points=pt_6, Tolerance=knob_10, CullMode=3)  # -> flatten(Points), Indices, Valence
panel_16 = Panel(cullpt_4.Points)
prox_2 = Proximity3D(Points=cullpt_4.Points, Group=Slider(10, range=0..10), MinRadius=knob_11, MaxRadius=knob_12)  # -> flatten(Links), Topology
line_8 = Line(flatten(prox_2.Links))
panel_17 = Panel(pt_6)
panel_18 = Panel(line_8)
knob_13 = ControlKnob(Decimals=2, Limit=True, Maximum=10, Minimum=0, Range=1, Value=0.13)
knob_14 = ControlKnob(Decimals=2, Limit=True, Maximum=10, Minimum=0, Range=1, Value=0.86)
knob_15 = ControlKnob(Decimals=2, Limit=True, Maximum=10, Minimum=0, Range=1, Value=1.92)
number_slider_3 = Slider(1, range=0..1)
geo_3 = Geometry(line_8)
line_9 = Line(Line((0, 0, 2), (0, 0, 0)))
divide_5 = DivideCurve(Curve=line_9, Count=number_slider_3, Kinks=False)  # -> Points, Tangents, Parameters
item_5 = ListItem(List=divide_5.Points, Index=number_slider_3, Wrap=True)
knob_16 = ControlKnob(Decimals=4, Limit=True, Maximum=10, Minimum=0, Range=1, Value=0)
pln_3 = Plane(Plane(origin=(0, 0, 0), x=(0, 0, 1), y=(1, 0, 0)))
rotate_3 = Rotate(Geometry=geo_3, Angle=knob_16, Plane=pln_3)  # -> Geometry, Transform
line_10 = Line(rotate_3.Geometry)
divide_6 = DivideCurve(Curve=line_10, Count=Slider(31, range=0..50), Kinks=False)  # -> flatten(Points), Tangents, reverse(Parameters)
panel_19 = Panel(line_10)
panel_20 = Panel(divide_6.Points)
cullpt_5 = CullDuplicates(Points=divide_6.Points, Tolerance=0.1, CullMode=3)  # -> Points, Indices, Valence
panel_21 = Panel(cullpt_5.Points)
ln_5 = Line(StartPoint=item_5, EndPoint=cullpt_5.Points)
vec_3 = Vector(flatten(ln_5))
panel_22 = Panel(vec_3)
item_6 = ListItem(List=cullpt_5.Points, Index=Slider(68, range=0..100), Wrap=True)
dist_3 = Distance(PointA=item_5, PointB=item_6)
panel_23 = Panel(dist_3)
knob_17 = ControlKnob(Decimals=2, Limit=True, Maximum=20, Minimum=0, Range=1, Value=12)
knob_18 = ControlKnob(Decimals=4, Limit=True, Maximum=20.1, Minimum=-20, Range=1, Value=1.0779)
addition_5 = Addition(A=dist_3, B=knob_18)
sph_3 = Sphere(Base=item_5, Radius=addition_5)
a_3 = Number(knob_17)
dom_3 = ConstructDomain(DomainStart=Slider(1e-06, range=0..1e-06), DomainEnd=a_3)
panel_24 = Panel(dom_3)
range_3 = Range(Domain=panel_24, Steps=Slider(62, range=0..100))
x_3 = Number(range_3)
pt_7 = Point(cullpt_5.Points)
sqr_5 = Square(Value=x_3)
sqr_6 = Square(Value=a_3)
subtraction_5 = Subtraction(A=sqr_6, B=sqr_5)
knob_19 = ControlKnob(Decimals=2, Limit=True, Maximum=10, Minimum=0, Range=1, Value=0.23)
sqrt_3 = SquareRoot(Value=subtraction_5)
knob_20 = ControlKnob(Decimals=2, Limit=True, Maximum=10, Minimum=0, Range=1, Value=0.86)
addition_6 = Addition(A=a_3, B=sqrt_3)
division_4 = Division(A=addition_6, B=x_3)
ln_6 = NaturalLogarithm(Value=division_4)
knob_21 = ControlKnob(Decimals=2, Limit=True, Maximum=10, Minimum=0, Range=1, Value=1.38)
multiplication_3 = Multiplication(A=ln_6, B=a_3)
subtraction_6 = Subtraction(A=multiplication_3, B=sqrt_3)
line_11 = Line(Line((0, 0, 0), (0, 0, 3)))
pt_8 = ConstructPoint(XCoordinate=x_3, YCoordinate=0, ZCoordinate=subtraction_6)
intcrv_3 = Interpolate(Vertices=pt_8, Degree=3, Periodic=False, KnotStyle=1)  # -> Curve, Length, Domain
revsrf_3 = Revolution(Curve=intcrv_3.Curve, Axis=line_11, Domain=Domain(0, 6.283185307))
project_3 = ProjectPoint(Point=cullpt_5.Points, Direction=ln_5, Geometry=revsrf_3)  # -> Point, Index
pt_9 = Point(flatten(project_3.Point))
cullpt_6 = CullDuplicates(Points=pt_9, Tolerance=knob_19, CullMode=3)  # -> flatten(Points), Indices, Valence
panel_25 = Panel(cullpt_6.Points)
prox_3 = Proximity3D(Points=cullpt_6.Points, Group=Slider(10, range=0..10), MinRadius=knob_20, MaxRadius=knob_21)  # -> flatten(Links), Topology
line_12 = Line(flatten(prox_3.Links))
merge = Merge(Data1=line_8, Data2=line_12)
panel_26 = Panel(merge)
divide_7 = DivideCurve(Curve=merge, Count=Slider(1, range=0..1), Kinks=False)  # -> Points, Tangents, Parameters
cullpt_7 = CullDuplicates(Points=divide_7.Points, Tolerance=knob_13, CullMode=3)  # -> flatten(Points), Indices, Valence
panel_27 = Panel(cullpt_7.Points)
prox_4 = Proximity3D(Points=cullpt_7.Points, Group=Slider(29, range=0..40), MinRadius=knob_14, MaxRadius=knob_15)  # -> flatten(Links), Topology
line_13 = Line(flatten(prox_4.Links))
panel_28 = Panel(line_13)
panel_29 = Panel(pt_9)
panel_30 = Panel(line_12)
